# Grasshopper definition dataMatcherTests.ghx (Grasshopper 0.9.76)

# Selects the correct master list when there are equal numbers of branches, but a deeper path in one case
num = Number([0.1, 0.11])
num_2 = Number([1, 2])
num_3 = Number([1, 2, 3, 4, 5])
# Matches two
#  trees with no branches
num_4 = Number([0.1, 0.11, 0.111])
# Selects the correct master list when there are more branches on the non-master path, but deeper branches on the master path
num_5 = Number([0.1, 0.11, 0.111])
num_6 = Number([1, 2])
# Matches three trees with no branches
num_7 = Number([0.1, 0.11, 0.111])
num_8 = Number([1, 2])
num_9 = Number([1000, 2000, 3000, 4000, 5000])
# Matches three trees with non-matching branch levels
num_10 = Number([0.1, 0.11, 0.111])
num_11 = Number([1, 2])
num_12 = Number([1000, 2000, 3000])
# Matches two trees with non-matching branch levels
num_13 = Number([0.1, 0.11, 0.111])
num_14 = Number([1, 2])
path_mapper = PathMapper(num, source="{0}(i)", target="{i}(0)")
graft = GraftTree(Tree=num_2, IncludeEmptyLists=True, IncludeNullItems=True)
path_mapper_2 = PathMapper(num_5, source="{0}(i)", target="{i}(0)")
graft_2 = GraftTree(Tree=num_6, IncludeEmptyLists=True, IncludeNullItems=True)
path_mapper_3 = PathMapper(num_10, source="{0}(i)", target="{i}(0)")
path_mapper_4 = PathMapper(num_12, source="{0}", target="{0;0;0;0}")
path_mapper_5 = PathMapper(num_13, source="{0}(i)", target="{i}(0)")
graft_3 = GraftTree(Tree=num_11, IncludeEmptyLists=True, IncludeNullItems=True)
graft_4 = GraftTree(Tree=num_14, IncludeEmptyLists=True, IncludeNullItems=True)
series = Series(Start=graft_4, Step=3, Count=2)
panel = Panel(path_mapper)
panel_2 = Panel(graft)
panel_3 = Panel(num_4)
panel_4 = Panel(path_mapper_2)
panel_5 = Panel(graft_2)
panel_6 = Panel(num_3)
panel_7 = Panel(num_7)
panel_8 = Panel(num_8)
panel_9 = Panel(path_mapper_3)
panel_10 = Panel(graft_3)
panel_11 = Panel(num_9)
panel_12 = Panel(path_mapper_4)
panel_13 = Panel(path_mapper_5)
panel_14 = Panel(series)
eval = Evaluate(F="a*b", a=path_mapper, b=graft)
eval_2 = Evaluate(F="a*b", a=path_mapper_2, b=graft_2)
eval_3 = Evaluate(F="a*b+c", a=path_mapper_3, b=graft_3, c=path_mapper_4)
eval_4 = Evaluate(F="a*b", a=num_4, b=num_3)
eval_5 = Evaluate(F="a*b+c", a=num_7, b=num_8, c=num_9)
panel_15 = Panel(eval)
eval_6 = Evaluate(F="a*b", a=path_mapper_5, b=series)
panel_16 = Panel(eval_2)
panel_17 = Panel(eval_3)
panel_18 = Panel(eval_4)
panel_19 = Panel(eval_5)
panel_20 = Panel(eval_6)
